# Grasshopper definition RoofIterations.gh (Grasshopper 0.9.76)
# plug-ins: Kangaroo Components, Weaverbird

c_script = CSharpScript(x=Slider(1, range=0..1), y=Slider(1, range=0..1), z=Slider(0, range=0..1))  # -> out, A, B; inputs x: Double, y: Double, z: Double
# ---------- c_script: C# ----------
    var points = new Point3d[5];
    for(int i = 0; i < points.Length; ++i)
    {

      points[i] = new Point3d(x, y, z);

    }

    A = points;

    B = points[0];
    
    /*
    var plane = new Plane(points[0], new Vector3d(0, 0, 1));

    var circle = new Rhino.Geometry.Circle(plane, 1);

    var curve = circle.ToNurbsCurve();
    int numOfPoints = 5;
    var pointsCircle = new Point3d[numOfPoints];
    curve.DivideByCount(numOfPoints, true, out pointsCircle);

    C = pointsCircle;
    */
# ---------- end c_script ----------
vector_xyz = VectorXYZ(XComponent=Slider(11, range=0..100), YComponent=Slider(24, range=0..100), ZComponent=Slider(0, range=0..100))  # -> Vector, Length
list_length = ListLength(List=c_script.A)
construct_point = ConstructPoint(XCoordinate=0, YCoordinate=0, ZCoordinate=0)
amplitude = Amplitude(Vector=vector_xyz.Vector, Amplitude=Slider(11, range=0..100))
construct_domain = ConstructDomain(DomainStart=Slider(9, range=0..360), DomainEnd=Slider(13, range=0..500))
construct_domain_2 = ConstructDomain(DomainStart=Slider(94, range=90..360), DomainEnd=Slider(353, range=0..500))
vector_display = VectorDisplay(Anchor=construct_point, Vector=amplitude)
random = Random(Range=construct_domain_2, Number=list_length, Seed=Slider(5418, range=0..10000))
random_2 = Random(Range=construct_domain, Number=list_length, Seed=Slider(5600, range=0..10000))
gene_pool = GenePool(Decimals=2, Maximum=5, Minimum=0, Value=[0, 5, 5, 0.62, 5])
unit_z = UnitZ(Factor=Slider(10, range=0..10))
move = Move(Geometry=construct_point, Motion=unit_z)  # -> Geometry, Transform
radians = Radians(Degrees=Slider(10, range=0..10))
gene_pool_2 = GenePool(Decimals=2, Maximum=10, Minimum=0, Value=[10, 10, 2.4, 7.55, 0])
amplitude_2 = Amplitude(Vector=amplitude, Amplitude=gene_pool)
unit_z_2 = UnitZ(Factor=1)
rotate = Rotate(Vector=amplitude_2, Axis=unit_z_2, Angle=gene_pool_2)
vector = Vector(rotate)
move_2 = Move(Geometry=c_script.A, Motion=rotate)  # -> Geometry, Transform
shift_list = ShiftList(List=move_2.Geometry, Shift=Slider(2, range=0..10), Wrap=True)

# ---- group: ShiftList
c_script_2 = CSharpScript(x=move_2.Geometry)  # -> out, A; inputs x: list of Point3d; disabled
# ---------- c_script_2: C# additional code ----------
  //private Rhino.Display.CustomDisplay m_display = new Rhino.Display.CustomDisplay(true);
  // https://stackoverflow.com/questions/21385066/shifting-array-elements-to-right/21385610#21385610
  // updated so that instead of shifting integers it shifts the Point3d[] list
  public Point3d[] shiftLeft(Point3d[] arr)
  {
    Point3d[] demo = new Point3d[arr.Length];

    for (int i = 0; i < arr.Length - 1; i++)
    {
      demo[i] = arr[i + 1];
    }

    demo[demo.Length - 1] = arr[0];

    return demo;
  }
# ---------- end c_script_2 ----------
panel = Panel(c_script_2.A)  # disabled

# ----
vector_display_2 = VectorDisplay(Anchor=c_script.A, Vector=rotate)
number_slider = Slider(2.328, range=0..10)
shift_list_2 = ShiftList(List=move_2.Geometry, Shift=1, Wrap=True)
point_list = PointList(Points=move_2.Geometry)
sortpointlist = CSharpScript(pointList=move_2.Geometry, tolerance=Slider(0.72, range=0..10))  # -> out, A; inputs pointList: list of Point3d, tolerance: Double
# ---------- sortpointlist: C# ----------
    var points = new Point3d[pointList.Count];

    points = Rhino.Geometry.Point3d.SortAndCullPointList(pointList, tolerance);

    A = points;
# ---------- end sortpointlist ----------
vector_2pt = Vector2Pt(PointA=c_script.A, PointB=sortpointlist.A, Unitize=False)  # -> Vector, Length
galapagos = Galapagos(fitness=fitness, gene=[gene_pool, gene_pool_2])
polyline = PolyLine(Vertices=move_2.Geometry, Closed=True)
convex_hull = ConvexHull(Points=move_2.Geometry, Plane=PlaneXY(0, 0, 0))  # -> Hull, HullZ, Indices
polyline_2 = PolyLine(Vertices=sortpointlist.A, Closed=True)
shift_list_3 = ShiftList(List=sortpointlist.A, Shift=1, Wrap=True)
vector_2pt_2 = Vector2Pt(PointA=c_script.A, PointB=shift_list_3, Unitize=False)  # -> Vector, Length
angle = Angle(VectorA=vector_2pt.Vector, VectorB=vector_2pt_2.Vector)  # -> Angle, Reflex
radianstodegrees = CSharpScript(Radians=angle.Angle)  # -> Degrees; inputs Radians: list of Double
# ---------- radianstodegrees: C# ----------
    var deg = new Double[Radians.Count];
    
    for( int i = 0; i < Radians.Count; ++i )
    {

      deg[i] = radToDeg(Radians[i]);

    }

    Degrees = deg;
# ---------- radianstodegrees: C# additional code ----------
  private double radToDeg(double rad)
  {

    double deg = 0.0;

    deg = rad * ( 180 / Math.PI );

    return deg;

  }
# ---------- end radianstodegrees ----------
panel_2 = Panel(radianstodegrees)
brep = Brep(polyline_2)
area = Area(Geometry=polyline_2)  # -> Area, Centroid
construct_point_2 = ConstructPoint(XCoordinate=Slider(0, range=0..10), YCoordinate=Slider(0, range=0..10), ZCoordinate=Slider(0, range=0..10))

# ---- group: MeshClothSimulation
delaunay_mesh = DelaunayMesh(Points=flatten([construct_point_2, sortpointlist.A]), Plane=PlaneXY(0, 0, 0))  # disabled
weaverbird_s_loop_subdivision = WeaverbirdsLoopSubdivision(MeshCurves=delaunay_mesh, Level=3, SmoothNakedEdges=0)  # disabled
number_slider_2 = Slider(26.232, range=0..1000)  # disabled
weld_mesh = WeldMesh(Mesh=weaverbird_s_loop_subdivision, Angle=3.141592654)  # disabled
unit_z_3 = UnitZ(Factor=number_slider_2)  # disabled
number_slider_3 = Slider(0.83104, range=0..1)  # disabled
deconstruct_mesh = DeconstructMesh(Mesh=weld_mesh)  # -> Vertices, Faces, Colours, Normals; disabled
unaryforce = UnaryForce(Point=deconstruct_mesh.Vertices, Force=unit_z_3)  # disabled
springsfrommesh = SpringsFromMesh(M=weld_mesh, stiffness=1000, B=number_slider_3)  # disabled
boolean_toggle = BooleanToggle(True)  # disabled
timer = Timer(TimerInterval=20, Target=kangaroophysics)  # disabled
kangaroophysics = KangarooPhysics(
    ForceObjects=[unaryforce, springsfrommesh],
    AnchorPoints=sortpointlist.A,
    Settings=null,
    Geometry=weld_mesh,
    SimulationReset=boolean_toggle)  # -> Out, Iterations, ParticlesOut, GeometryOut, KE; disabled
deconstruct_mesh_2 = DeconstructMesh(Mesh=kangaroophysics.GeometryOut)  # -> Vertices, Faces, Colours, Normals; disabled
deconstruct_face = DeconstructFace(Face=deconstruct_mesh_2.Faces)  # -> CornerA, CornerB, CornerC, CornerD; disabled
list_item = ListItem(List=deconstruct_mesh_2.Vertices, Index=deconstruct_face.CornerA, Wrap=True)  # disabled
list_item_2 = ListItem(List=deconstruct_mesh_2.Vertices, Index=deconstruct_face.CornerB, Wrap=True)  # disabled
list_item_3 = ListItem(List=deconstruct_mesh_2.Vertices, Index=deconstruct_face.CornerC, Wrap=True)  # disabled
_4point_surface = _4PointSurface(CornerA=list_item, CornerB=list_item_2, CornerC=list_item_3)  # disabled
is_planar = IsPlanar(Surface=_4point_surface, Interior=True)  # -> Planar, Plane; disabled

# ----
discontinuity = Discontinuity(Curve=brep, Level=1)  # -> Points, Parameters
sort_list = SortList(Keys=radianstodegrees)  # -> Keys, ValuesValuesA
angular_dimension = AngularDimension(
    Center=c_script.A,
    PointA=sortpointlist.A,
    PointB=shift_list_3,
    Reflex=False,
    Text="{0:0.0}°",
    Size=Slider(0.2051, range=0..1))
vector_2pt_3 = Vector2Pt(PointA=sortpointlist.A, PointB=shift_list_3, Unitize=False)  # -> Vector, Length
line = Line(StartPoint=shift_list_3, EndPoint=sortpointlist.A)
panel_3 = Panel(sort_list.Keys)
number = Number(area.Area)
panel_4 = Panel(number)
list_item_4 = ListItem(List=sort_list.Keys, Index=Slider(0, range=0..5), Wrap=True)
line_2 = Line(StartPoint=construct_point_2, EndPoint=move_2.Geometry)
sort_list_2 = SortList(Keys=vector_2pt_3.Length)  # -> Keys, ValuesA
mass_addition = MassAddition(Input=panel_3)  # -> Result, PartialResults
mass_addition_2 = MassAddition(Input=vector_2pt_3.Length)  # -> Result, PartialResults
number_2 = Number(list_item_4)
panel_5 = Panel(number_2)
vector_display_3 = VectorDisplay(Anchor=sortpointlist.A, Vector=vector_2pt_3.Vector)
list_item_5 = ListItem(List=sort_list_2.Keys, Index=0, Wrap=True)  # -> Item, Item1, Item2, Item3, Item4
panel_6 = Panel(mass_addition.Result)
list_length_2 = ListLength(List=vector_2pt_3.Length)
fitness = CSharpScript(area=number, lineLength=sort_list_2.Keys, brep=brep, angle=number_2)  # -> out, A, B; inputs area: Double, lineLength: list of Double, brep: Brep, angle: Double
# ---------- fitness: C# ----------
    var lengths = lineLength.ToArray();
    var shift = shiftLeft(lengths);
    var douOut = area;

    for(int i = 0; i < lengths.Length; ++i)
    {

      if( (lengths[i]) == (shift[i]) )
      {

        douOut -= 50;

      }


      if( lengths[i] == 0 )
      {

        douOut -= 50;

      }

    }

    if(brep == null)
    {

      douOut *= 500;

    }
    /*
    if(angle > 30 || angle == 0)
    {

      douOut += 20;

    }
    */

    A = douOut;
# ---------- fitness: C# additional code ----------
  //private Rhino.Display.CustomDisplay m_display = new Rhino.Display.CustomDisplay(true);
  // https://stackoverflow.com/questions/21385066/shifting-array-elements-to-right/21385610#21385610
  // updated so that instead of shifting integers it shifts the Point3d[] list
  public Double[] shiftLeft(Double[] arr)
  {
    Double[] demo = new Double[arr.Length];

    for (int i = 0; i < arr.Length - 1; i++)
    {
      demo[i] = arr[i + 1];
    }

    demo[demo.Length - 1] = arr[0];

    return demo;
  }
# ---------- end fitness ----------
expression = Expression(x=number, y=list_item_5.Item, Expression="(x) + (y)")
division = Division(A=mass_addition_2.Result, B=list_length_2)
panel_7 = Panel(fitness.A)
panel_8 = Panel(fitness.B)
panel_9 = Panel(sort_list_2.Keys)

# ---- group: Catenary
shift_list_4 = ShiftList(List=sortpointlist.A, Shift=1, Wrap=True)  # disabled
number_slider_4 = Slider(7, range=0..50)  # disabled
line_3 = Line(StartPoint=sortpointlist.A, EndPoint=shift_list_4)  # disabled
number_slider_5 = Slider(84, range=0..500)  # disabled
divide_curve = DivideCurve(Curve=line_3, Count=number_slider_4, Kinks=True)  # -> Points, Tangents, Parameters; disabled
unit_z_4 = UnitZ(Factor=number_slider_5)  # disabled
shatter = Shatter(Curve=line_3, Parameters=divide_curve.Parameters)  # disabled
number_slider_6 = Slider(0.848, range=0..10)  # disabled
end_points = EndPoints(Curve=line_3)  # -> Start, End; disabled
unaryforce_2 = UnaryForce(Point=divide_curve.Points, Force=unit_z_4)  # disabled
springsfromline = SpringsFromLine(
    Connection=shatter,
    Stiffness=1000,
    Damping=number_slider_6,
    RestLength=shatter,
    UpperCutoff=0,
    LowerCutoff=0,
    Plasticity=0)  # disabled
boolean_toggle_2 = BooleanToggle(False)  # disabled
kangaroophysics_2 = KangarooPhysics(
    ForceObjects=flatten([springsfromline, unaryforce_2]),
    AnchorPoints=[end_points.Start, end_points.End],
    Settings=null,
    Geometry=flatten(shatter),
    SimulationReset=boolean_toggle_2)  # -> Out, Iterations, ParticlesOut, GeometryOut, KE; disabled
timer_2 = Timer(TimerInterval=20, Target=kangaroophysics_2)  # disabled

# ----
number_slider_7 = Slider(13, range=0..50)  # disabled
number_slider_8 = Slider(11.04, range=0..500)  # disabled
divide_curve_2 = DivideCurve(Curve=line_2, Count=number_slider_7, Kinks=True)  # -> Points, Tangents, Parameters; disabled
unit_z_5 = UnitZ(Factor=number_slider_8)  # disabled
unaryforce_3 = UnaryForce(Point=divide_curve_2.Points, Force=unit_z_5)  # disabled
shatter_2 = Shatter(Curve=line_2, Parameters=divide_curve_2.Parameters)  # disabled
number_slider_9 = Slider(0.848, range=0..10)  # disabled
end_points_2 = EndPoints(Curve=line_2)  # -> Start, End; disabled
springsfromline_2 = SpringsFromLine(
    Connection=shatter_2,
    Stiffness=1000,
    Damping=number_slider_9,
    RestLength=shatter_2,
    UpperCutoff=0,
    LowerCutoff=0,
    Plasticity=0)  # disabled
boolean_toggle_3 = BooleanToggle(False)  # disabled
kangaroophysics_3 = KangarooPhysics(
    ForceObjects=flatten([springsfromline_2, unaryforce_3]),
    AnchorPoints=[end_points_2.Start, end_points_2.End],
    Settings=null,
    Geometry=flatten(shatter_2),
    SimulationReset=boolean_toggle_3)  # -> Out, Iterations, ParticlesOut, GeometryOut, KE; disabled
timer_3 = Timer(TimerInterval=20, Target=kangaroophysics_3)  # disabled
number_slider_10 = Slider(4, range=0..4)  # disabled
point = Point(kangaroophysics_3.ParticlesOut)  # disabled
partition_list = PartitionList(List=kangaroophysics_3.GeometryOut, Size=number_slider_7)  # -> simplify(Chunks); disabled
point_2 = Point(kangaroophysics_2.ParticlesOut)  # disabled
construct_path = ConstructPath(Indices=number_slider_10)  # disabled
polyline_3 = PolyLine(Vertices=point_2, Closed=True)  # disabled
tree_branch = TreeBranch(Tree=partition_list, Path=construct_path, MaintainPaths=True)  # disabled
partition_list_2 = PartitionList(List=kangaroophysics_2.GeometryOut, Size=number_slider_4)  # -> simplify(Chunks); disabled
number_slider_11 = Slider(4, range=0..4)  # disabled
join_curves = JoinCurves(Curves=partition_list, Preserve=False)  # -> flatten(Curves); disabled
number_slider_12 = Slider(4, range=0..4)  # disabled
join_curves_2 = JoinCurves(Curves=partition_list_2, Preserve=False)  # -> flatten(Curves); disabled
construct_path_2 = ConstructPath(Indices=number_slider_11)  # disabled
list_item_6 = ListItem(List=join_curves, Index=number_slider_12, Wrap=True)  # disabled
tree_branch_2 = TreeBranch(Tree=partition_list_2, Path=construct_path_2, MaintainPaths=True)  # disabled
list_item_7 = ListItem(List=join_curves_2, Index=0, Wrap=True)  # disabled

# ==== cluster SpringsFromMesh: Turns all edges of a mesh into springs
M = ClusterInput()
medges = MeshEdges(Mesh=M)  # -> NakedEdges, InteriorEdges, NonManifoldEdges
crv = Curve([medges.NakedEdges, medges.InteriorEdges])
B = ClusterInput()
len = Length(Curve=crv)
multiplication = Multiplication(A=len, B=B)
stiffness = ClusterInput()
springs = SpringsFromLine(Connection=crv, Stiffness=stiffness, Damping=10, RestLength=multiplication, UpperCutoff=0, LowerCutoff=0, Plasticity=0)
S = ClusterOutput(springs)
